# Dynamo custom node AboutPackage.dyf (Dynamo 2.3.0.5885)
# category: GoldenEagle.About
# Feel Free to contact me one below mail if you have any queries.

# note: Package Name - Golden Eagle
# Author - Prem Talreja
# Contact - goldeneagle.bim@gmail.com
# Node Name - AboutPackage
python_script = Python()  # unwired: IN[0]
# ---------- python_script.python (6 lines) ----------
#Package Name - Golden Eagle
#Author - Prem Talreja
#Contact - goldeneagle.bim@gmail.com


OUT = "Package : Golden Eagle" , "Author : Prem Talreja","Contact : goldeneagle.bim@gmail.com"
# ----------------------------------------
Details = Output(python_script)
