# Dynamo custom node CADBlockToRevitFamily.dyf (Dynamo 2.3.0.5885)
# category: GoldenEagle.CADTOBIM
# Place Family By Selecting CAD Block Name, Family Type and Level

importInstance = Input(importInstance: var[]..[])
# note: Package Name - Golden Eagle
# Author - Prem Talreja
# Contact - goldeneagle.bim@gmail.com
# Node Name - CAD Block to Revit Family
# [Custom Node use of Genius Loci]
python_script = Python(IN[0]=importInstance)
# ---------- python_script.python (41 lines) ----------
#Alban de Chasteigner 2021
#twitter : @geniusloci_bim
#geniusloci.bim@gmail.com
#https://github.com/albandechasteigner/GeniusLociForDynamo
  
import clr
clr.AddReference('RevitAPI')
import Autodesk
from Autodesk.Revit.DB import Options,GeometryInstance, XYZ
clr.AddReference("RevitNodes")
import Revit
clr.ImportExtensions(Revit.GeometryConversion)
clr.ImportExtensions(Revit.Elements)
import math

points,rotations,blocks,layersAll=[],[],[],[]

elem = UnwrapElement(IN[0])
geoElem = elem.get_Geometry(Options())		
for geoObj in geoElem:
	transform=geoObj.Transform
	instance=geoObj.SymbolGeometry
	for inst in instance:
		layers=[]
		if isinstance(inst,GeometryInstance):
			points.append(transform.OfPoint(inst.Transform.Origin).ToPoint())
			rotation=abs(math.degrees(inst.Transform.BasisX.AngleOnPlaneTo(XYZ.BasisX, XYZ.BasisZ))-360)
			if round(rotation,3)==360:
				rotation = 0
			rotations.append(round(rotation,3))
			blocks.append(inst.Symbol.ToDSType(True).Name.split(".dwg.")[-1])
			geom=inst.SymbolGeometry
			for geo in geom:
				try:
					layers.append(elem.Document.GetElement(geo.GraphicsStyleId).GraphicsStyleCategory.Name)
				except:
					layers.append(None)
			if layers != [] : layersAll.append(layers[0])
			else : layersAll.append(layers)
			
OUT = blocks,points,rotations,layersAll
# ----------------------------------------
code_block = CodeBlock(x=python_script) { x[0]; x[1]; x[2]; x[3]; }
code_block_2 = CodeBlock(t1=code_block.out0) { t2 = DSCore.List.Flatten(t1, -1); }
string_from_object = FromObject(obj=code_block_2)
CADBlockName = Input(CADBlockName: string)
FamilyTypeName = Input(FamilyTypeName: var[]..[])
LevelofFamily = Input(LevelofFamily: var[]..[])
code_block_3 = CodeBlock(t1=string_from_object, t2=CADBlockName, t3=code_block.out1, t7=FamilyTypeName, t8=LevelofFamily)
# ---------- code_block_3.designscript (5 lines) ----------
bool1 = String.Contains(t1, t2, false);
t4 = DSCore.List.FilterByBoolMask(t3, bool1);
t5 = Dictionary.ValueAtKey(t4, "in");
t6 = Dictionary.ValueAtKey(t4, "out");
familyinstance1 = FamilyInstance.ByPointAndLevel(t7, t5, t8);
# ----------------------------------------
FamilyInstance = Output(code_block_3.familyinstance1)
