# Dynamo custom node COBieComponentDescription.dyf (Dynamo 2.3.0.5885)
# category: GoldenEagle.COBie
# Fill up COBie.Component.Description by this code, Make sure COBie.Component.Name filled.

Elements = Input(Elements: var[]..[])
# note: Package Name - Golden Eagle
# Author - Prem Talreja
# Contact - goldeneagle.bim@gmail.com
# Node Name - COBieCompoenentDescription
code_block = CodeBlock(t1=Elements)
# ---------- code_block.designscript (5 lines) ----------
category1 = Elements.Element.GetCategory(t1);
t2 = category1 + "-";
t3 = Elements.Element.GetParameterValueByName(t1, "COBie.Component.Name");
t4 = t2 + t3;
element1 = Elements.Element.SetParameterByName(t1, "COBie.Component.Description", t4);
# ----------------------------------------
Element = Output(code_block.element1)
