# Dynamo custom node COBieCreatedOn.dyf (Dynamo 2.3.0.5885)
# category: GoldenEagle.COBie
# COBie.CreatedOn data fill live date and time on parameter

Elements = Input(Elements: var[]..[])
code_block = CodeBlock { str2 = "COBie.CreatedOn"; str1 = "%d-%m-%y"; }
python_script = Python(IN[0]=code_block.str1)
# ---------- python_script.python (11 lines) ----------
import sys

sys.path.append(r"C:\Program Files (x86)\IronPython 2.7\Lib")

from datetime import datetime

now = datetime.now()

str_format = IN[0]

OUT = now.strftime(str_format)
# ----------------------------------------
string_from_object = FromObject(obj=python_script)
# note: Package Name - Golden Eagle
# Author - Prem Talreja
# Contact - goldeneagle.bim@gmail.com
# Node Name - COBie.CreatedOn
code_block_2 = CodeBlock(t1=Elements, str1=code_block.str2, t2=string_from_object) { element1 = Elements.Element.SetParameterByName(t1, str1, t2); }
Element = Output(code_block_2)
