# Dynamo custom node COBieSerialNumber.dyf (Dynamo 2.3.0.5885)
# category: GoldenEagle.COBie
# Set Serial Number by selecting elements

Elements = Input(Elements: var[]..[])
code_block = CodeBlock { "COBie.SerialNumber"; }
# note: Package Name - Golden Eagle
# Author - Prem Talreja
# Contact - goldeneagle.bim@gmail.com
# Node Name - COBie.SerialNumber
serialNumberByName = Custom[SerialNumberByName](Elements=Elements, ParameterName=code_block)  # Set Serial Number to elements parameters
Element = Output(serialNumberByName)
