# Dynamo custom node COBieTypeCategory.dyf (Dynamo 2.3.0.5885)
# category: GoldenEagle.COBie
# Fill type category by selecting elements.

Element = Input(Element: var[]..[])
code_block = CodeBlock(t1=Element) { category1 = Elements.Element.GetCategory(t1); }
string_from_object = FromObject(obj=code_block)
# note: Package Name - Golden Eagle
# Author - Prem Talreja
# Contact - goldeneagle.bim@gmail.com
# Node Name - COBieTypeCategory
code_block_2 = CodeBlock(t1=Element, t2=string_from_object)
# ---------- code_block_2.designscript (2 lines) ----------
element1 = Elements.Element.ElementType(t1);
element2 = Elements.Element.SetParameterByName(element1, "COBie.Type.Category", t2);
# ----------------------------------------
Element_2 = Output(code_block_2.element2)  # "Element"
