# Dynamo custom node COBieTypeName.dyf (Dynamo 2.3.0.5885)
# category: GoldenEagle.COBie
# Fill Element Name by Selecting Elements

Element = Input(Element: var[]..[])
# note: Package Name - Golden Eagle
# Author - Prem Talreja
# Contact - goldeneagle.bim@gmail.com
# Node Name - COBieTypeName
code_block = CodeBlock(t1=Element)
# ---------- code_block.designscript (3 lines) ----------
element1 = Elements.Element.ElementType(t1);
str2 = Elements.Element.Name(t1);
element2 = Elements.Element.SetParameterByName(element1, "COBie.Type.Name", str2);
# ----------------------------------------
Element_2 = Output(code_block.element2)  # "Element"
