# Dynamo custom node ConduitfromPointcloudBySelectPoints.dyf (Dynamo 2.3.0.5885)
# category: GoldenEagle.SCANToBIM
# Model Conduit by select points from scan file,
# Script based on sastrugi package.
# packages: MEPover 2019.12.1, ghfjehueiv 1.1.1

code_block = CodeBlock { 10000; }
SelectPoints = Input(SelectPoints: bool = true)
pointcloud_select_points_in_view = Custom[❄_Pointcloud Select Points in View](PointSampleSize=code_block, Refresh=SelectPoints)  # package ghfjehueiv; (Sastrugi_Pointcloud_Geometry) This node allows users to select a specific number of Pointcloud Points by creating a selection region in the Active View.
byBestFitThroughPoints = Line.ByBestFitThroughPoints(bestFitPoints=pointcloud_select_points_in_view.Points)
code_block_2 = CodeBlock { [0.3,0.4,0.5,0.6,0.7]; }
planeAtParameter = Curve.PlaneAtParameter(curve=byBestFitThroughPoints, param=code_block_2)
distanceTo = Geometry.DistanceTo(geometry=planeAtParameter, other=pointcloud_select_points_in_view.Points, lacing=CrossProduct)
sortIndexByValue = List.SortIndexByValue(list=distanceTo)
code_block_3 = CodeBlock { 20; }
takeItems = List.TakeItems(list=sortIndexByValue@L2, amount=code_block_3)
getItemAtIndex = List.GetItemAtIndex(list=pointcloud_select_points_in_view.Points, index=takeItems)
byBestFitThroughPoints_2 = Circle.ByBestFitThroughPoints(points=getItemAtIndex)
centerPoint = Circle.CenterPoint(circle=byBestFitThroughPoints_2)
byBestFitThroughPoints_3 = Line.ByBestFitThroughPoints(bestFitPoints=centerPoint)
element_types = ElementTypes("ConduitType")
all_elements_of_type = ElementsOfType(element_type=element_types)
code_block_4 = CodeBlock(conduit=all_elements_of_type) { conduit[0]; }
# note: Package Name - Golden Eagle
# Author - Prem Talreja
# Contact - goldeneagle.bim@gmail.com
# Node Name - Pipe By Pointcloud
# [Script by Sastrugi based on dynamo forum>Updated By Prem Talreja]
SelectLevel = Input(SelectLevel: var[]..[])
radius = Circle.Radius(circle=byBestFitThroughPoints_2)
average = Math.Average(numbers=radius)
code_block_5 = CodeBlock(dist=average) { dist*2; }
byLines = Custom[Conduit.ByLines](Lines=byBestFitThroughPoints_3, ConduitType=code_block_4, level=SelectLevel, Diameter=code_block_5)  # package MEPover; Creates conduits by Line, ConduitType, Level and Diameter
Conduits = Output(byLines)
