# Dynamo custom node CreateWorksetByExcel.dyf (Dynamo 2.3.0.5885)
# category: GoldenEagle.Workset
# Create Workset By Excel Data

filePath = Input(filePath: string)
file_from_path = FileObject(path=filePath)
sheetName = Input(sheetName: string = "Sheet1")
readAsStrings = Input(readAsStrings: bool = false)
showExcel = Input(showExcel: bool = false)
# note: Package Name - Golden Eagle
# Author - Prem Talreja
# Contact - goldeneagle.bim@gmail.com
# Node Name - Create Worksets By Excel
code_block = CodeBlock(t2=file_from_path, t3=sheetName, t4=readAsStrings, t5=showExcel)
# ---------- code_block.designscript (5 lines) ----------
t1 = DSOffice.Data.ImportExcel(t2, t3, t4, t5);
bool1 = DSCore.Object.IsNull(t1);
t6 = DSCore.List.FilterByBoolMask(t1, bool1);
t7 = Dictionary.ValueAtKey(t6, "in");
t8 = Dictionary.ValueAtKey(t6, "out");
# ----------------------------------------
watch = Watch(code_block.t8)
code_block_2 = CodeBlock(t1=watch) { t2 = DSCore.List.Flatten(t1, -1); }
createWorksetByName = Custom[CreateWorksetByName](name=code_block_2)  # Create Workset By name
Workset = Output(createWorksetByName)
