# Dynamo custom node CreateWorksetByName.dyf (Dynamo 2.3.0.5885)
# category: GoldenEagle.Workset
# Create Workset By name

name = Input(name: string[]..[])
# note: Package Name - Golden Eagle
# Author - Prem Talreja
# Contact - goldeneagle.bim@gmail.com
# Node Name - Workset By Name
python_script = Python(IN[0]=name)
# ---------- python_script.python (35 lines) ----------
#Package Name - Golden Eagle
#Author - Prem Talreja
#Contact - goldeneagle.bim@gmail.com

import sys
import clr
clr.AddReference('ProtoGeometry')
from Autodesk.DesignScript.Geometry import *

clr.AddReference('RevitAPI')
import Autodesk
from Autodesk.Revit.DB import *

clr.AddReference("RevitServices")
import RevitServices
from RevitServices.Persistence import DocumentManager
from RevitServices.Transactions import TransactionManager

doc = DocumentManager.Instance.CurrentDBDocument
TransactionManager.Instance.EnsureInTransaction(doc)

WorksetNames = [IN[0]]
WorksetList = []
	
TransactionManager.Instance.EnsureInTransaction(doc)
if isinstance(IN[0], list):
	for workset in IN[0]:
		Workset = Workset.Create(doc, workset)
		WorksetList.append(workset)
else:
	WorksetList.append(IN[0])		

	
TransactionManager.Instance.TransactionTaskDone()
OUT = WorksetList
# ----------------------------------------
Workset = Output(python_script)
