# Dynamo custom node DimensionSuffixByName.dyf (Dynamo 2.3.0.5885)
# category: GoldenEagle.Dimension
# Set Suffix Value on dimensions by dimension name

categories = Categories("OST_Dimensions")  # graph input
all_elements_of_category = ElementsOfCategory(Category=categories)
DimensionName = Input(DimensionName: var[]..[])
# note: Package Name - Golden Eagle
# Author - Prem Talreja
# Contact - goldeneagle.bim@gmail.com
# Node Name - Dimension Suffix By Name
code_block = CodeBlock(t1=all_elements_of_category, t2=DimensionName)
# ---------- code_block.designscript (5 lines) ----------
str1 = Elements.Element.Name(t1);
bool1 = String.Contains(str1, t2, false);
t3 = DSCore.List.FilterByBoolMask(t1, bool1);
t4 = Dictionary.ValueAtKey(t3, "in");
t5 = Dictionary.ValueAtKey(t3, "out");
# ----------------------------------------
SuffixValue = Input(SuffixValue: var[]..[])
python_script = Python(IN[0]=code_block.t4, IN[1]=SuffixValue)
# ---------- python_script.python (20 lines) ----------
import clr
clr.AddReference('RevitServices')
import RevitServices
from RevitServices.Persistence import DocumentManager
from RevitServices.Transactions import TransactionManager
doc = DocumentManager.Instance.CurrentDBDocument

dims = UnwrapElement(IN[0])
sfix = IN[1]

TransactionManager.Instance.EnsureInTransaction(doc)
for i in dims :
	if i.Value >= 0 :
		i.Suffix = sfix
	else :
		for j in i.Segments :
			j.Suffix = sfix
TransactionManager.Instance.TransactionTaskDone()

OUT = [dims],[sfix]
# ----------------------------------------
DimensionNameandValue = Output(python_script)
