# Dynamo custom node FamilyPlacingBySelectPoint.dyf (Dynamo 2.3.0.5885)
# category: GoldenEagle.SCANToBIM
# Place family by selecting points from scan file
# packages: ghfjehueiv 1.1.1

FamilyTypes = Input(FamilyTypes: var[]..[])
SelectPoints = Input(SelectPoints: bool = true)
pointcloud_select_point = Custom[❄_Pointcloud Select Point](Refresh=SelectPoints)  # package ghfjehueiv; (Sastrugi_Pointcloud_Geometry) This node allows the selection of a single point from a Pointcloud Instance.
byPoint = FamilyInstance.ByPoint(familyType=FamilyTypes, point=pointcloud_select_point)
FamilyInstance = Output(byPoint)
