# Dynamo custom node GetWorksetofAllKind.dyf (Dynamo 2.3.0.5885)
# category: GoldenEagle.Workset
# Get All Kind of workset from revit

# note: Package Name - Golden Eagle
# Author - Prem Talreja
# Contact - goldeneagle.bim@gmail.com
# Node Name - Get Workset of all kind
python_script = Python()  # unwired: IN[0]
# ---------- python_script.python (21 lines) ----------
#Package Name - Golden Eagle
#Author - Prem Talreja
#Contact - goldeneagle.bim@gmail.com


import clr
clr.AddReference('RevitAPI')
from Autodesk.Revit.DB import *
import Autodesk

clr.AddReference("RevitServices")
import RevitServices
from RevitServices.Persistence import DocumentManager

doc = DocumentManager.Instance.CurrentDBDocument

collector = FilteredWorksetCollector(doc)
worksetnames = []
for wset in collector:
	worksetnames.append(wset.Name)
OUT = collector, worksetnames
# ----------------------------------------
Workset = Output(python_script)
