# Dynamo custom node GetandSetParameterValueByElement.dyf (Dynamo 2.3.0.5885)
# category: GoldenEagle.Parameter
# Get Value from element parameter and set it on other elements.

GetElements = Input(GetElements: var[]..[])
ParameterName = Input(ParameterName: string)
SetElements = Input(SetElements: var[]..[])
# note: Package Name - Golden Eagle
# Author - Prem Talreja
# Contact - goldeneagle.bim@gmail.com
# Node Name - Get and Set Parameter value by Element
code_block = CodeBlock(t2=GetElements, t3=ParameterName, t4=SetElements) { t1 = Elements.Element.GetParameterValueByName(t2, t3); element1 = Elements.Element.SetParameterByName(t4, t3, t1); }
Element = Output(code_block.element1)
