# Dynamo custom node GetandSetParameterValueByName.dyf (Dynamo 2.3.0.5885)
# category: GoldenEagle.Parameter
# Get Parameter Value From Element and Set it on other Parameter.
# packages: Golden Eagle 2022.3.14

Elements = Input(Elements: var[]..[])
SetparameterName = Input(SetparameterName: string)
GetparameterName = Input(GetparameterName: string)
# note: Package Name - Golden Eagle
# Author - Prem Talreja
# Contact - goldeneagle.bim@gmail.com
# Node Name - Getandset parameter in single node
code_block = CodeBlock(t1=Elements, t2=GetparameterName) { t3 = Elements.Element.GetParameterValueByName(t1, t2); }
string_from_object = FromObject(obj=code_block)
code_block_2 = CodeBlock(t1=Elements, t2=SetparameterName, t3=string_from_object) { element1 = Elements.Element.SetParameterByName(t1, t2, t3); }
Element = Output(code_block_2)
aboutPackage = Custom[AboutPackage]()  # package Golden Eagle; Feel Free to contact me one below mail if you have any queries.
