# Dynamo custom node GitHub.dyf (Dynamo 2.3.0.5885)
# category: GoldenEagle.About
# It opens my github repositories.

runMe = Input(runMe: bool = false)
# note: Package Name - Golden Eagle
# Author - Prem Talreja
# Contact - goldeneagle.bim@gmail.com
# Node Name - My Github Repositories
python_script = Python(IN[0]=runMe)
# ---------- python_script.python (11 lines) ----------
#Package Name - Golden Eagle
#Author - Prem Talreja
#Contact - goldeneagle.bim@gmail.com

import os

if IN[0]:
	os.system("start \"\" https://github.com/PremTalreja/")
	OUT = "Welcome"
else:
	OUT = "Set True on Boolean"
# ----------------------------------------
OUT = Output(python_script)
