# Dynamo custom node ImportFromExcel.dyf (Dynamo 2.3.0.5885)
# category: GoldenEagle.Data
# Data Import from excel without any null or empty data.

filePath = Input(filePath: string)
file_from_path = FileObject(path=filePath)
sheetName = Input(sheetName: string = "Sheet1")
readAsStrings = Input(readAsStrings: bool = false)
showExcel = Input(showExcel: bool = false)
code_block = CodeBlock(t2=file_from_path, t3=sheetName, t4=readAsStrings, t5=showExcel)
# ---------- code_block.designscript (7 lines) ----------
t1 = DSOffice.Data.ImportExcel(t2, t3, t4, t5);
t6 = DSCore.List.Flatten(t1, -1);
bool1 = DSCore.Object.IsNull(t6);
t7 = DSCore.List.FilterByBoolMask(t6, bool1);
t8 = Dictionary.ValueAtKey(t7, "in");
t9 = Dictionary.ValueAtKey(t7, "out");
t10 = DSCore.List.Flatten(t9, -1);
# ----------------------------------------
# note: Package Name - Golden Eagle
# Author - Prem Talreja
# Contact - goldeneagle.bim@gmail.com
# Node Name - Import From Excel
Outlist = Output(code_block.t10)
