# Dynamo custom node ListGroupByElementName.dyf (Dynamo 2.3.0.5885)
# category: GoldenEagle.List
# Group element by name by selecting category

SelectCategories = Input(SelectCategories: var[]..[])
all_elements_of_category = ElementsOfCategory(Category=SelectCategories)
# note: Package Name - Golden Eagle
# Author - Prem Talreja
# Contact - goldeneagle.bim@gmail.com
# Node Name - ListGroupByName
code_block = CodeBlock(t1=all_elements_of_category)
# ---------- code_block.designscript (4 lines) ----------
str1 = Elements.Element.Name(t1);
t2 = DSCore.List.GroupByKey(t1, str1);
t3 = Dictionary.ValueAtKey(t2, "groups");
t4 = Dictionary.ValueAtKey(t2, "unique keys");
# ----------------------------------------
grouped_keys = Output(code_block.t4)
grouped_list = Output(code_block.t3)
