# Dynamo custom node ListGroupElementByParameterValue.dyf (Dynamo 2.3.0.5885)
# category: GoldenEagle.List
# Group Elements by parameter value

Elements = Input(Elements: var[]..[])
ParameterName = Input(ParameterName: string)
# note: Package Name - Golden Eagle
# Author - Prem Talreja
# Contact - goldeneagle.bim@gmail.com
# Node Name - List group by Parameter Value
code_block = CodeBlock(t2=Elements, t3=ParameterName)
# ---------- code_block.designscript (4 lines) ----------
t1 = Elements.Element.GetParameterValueByName(t2, t3);
t4 = DSCore.List.GroupByKey(t2, t1);
t5 = Dictionary.ValueAtKey(t4, "groups");
t6 = Dictionary.ValueAtKey(t4, "unique keys");
# ----------------------------------------
grouped_keys = Output(code_block.t6)
grouped_list = Output(code_block.t5)
