# Dynamo custom node ListSortByParameterValue.dyf (Dynamo 2.3.0.5885)
# category: GoldenEagle.List
# Sort Your List By Selected Element Parameter

Elements = Input(Elements: var[]..[])
ParameterName = Input(ParameterName: string)
code_block = CodeBlock(t2=Elements, t3=ParameterName)
# ---------- code_block.designscript (4 lines) ----------
t1 = Elements.Element.GetParameterValueByName(t2<1L>, t3<1L>);
t4 = DSCore.List.SortByKey(t2, t1);
t5 = Dictionary.ValueAtKey(t4, "sorted list");
t6 = Dictionary.ValueAtKey(t4, "sorted keys");
# ----------------------------------------
# note: Package Name - Golden Eagle
# Author - Prem Talreja
# Contact - goldeneagle.bim@gmail.com
# Node Name - List Sort by Parameter Value
sorted_list = Output(code_block.t5)
sorted_keys = Output(code_block.t6)
