# Dynamo custom node NavisworksColorOverrideClashElementInView.dyf (Dynamo 2.3.0.5885)
# category: GoldenEagle.Navisworks
# Change Color Of Clashed Elements In View,
# Make Sure Excel Exported from Navisworks is tick with ID ELEMENT Only.

FilePath = Input(FilePath: string)
sheetName = Input(sheetName: string = "Sheet1")
importFromExcel = Custom[ImportFromExcel](filePath=FilePath, sheetName=sheetName)  # Data Import from excel without any null or empty data.
# note: Package Name - Golden Eagle
# Author - Prem Talreja
# Contact - goldeneagle.bim@gmail.com
# Node Name - Clash Color Override from Navisworks Report
code_block = CodeBlock(t2=importFromExcel)
# ---------- code_block.designscript (5 lines) ----------
t1 = DSCore.List.Transpose(t2);
bool1 = DSCore.Object.IsNull(t1);
t3 = DSCore.List.FilterByBoolMask(t1, bool1);
t4 = Dictionary.ValueAtKey(t3, "in");
t5 = Dictionary.ValueAtKey(t3, "out");
# ----------------------------------------
string_from_object = FromObject(obj=code_block.t5)
color = Input(color: var[]..[])
code_block_2 = CodeBlock(t2=string_from_object, t7=color)
# ---------- code_block_2.designscript (9 lines) ----------
str1 = String.Remove(t2, 0, 12);
t3 = Select.ByElementId(str1);
bool1 = DSCore.Object.IsNull(t3);
t4 = DSCore.List.FilterByBoolMask(t3, bool1);
t5 = Dictionary.ValueAtKey(t4, "in");
t6 = Dictionary.ValueAtKey(t4, "out");
element1 = Elements.Element.OverrideColorInView(t6, t7);
_element = element1;
t1 = _element;
# ----------------------------------------
ClashedElement = Output(code_block_2.t1)
