# Dynamo custom node NavisworksIsolateClashElementInView.dyf (Dynamo 2.3.0.5885)
# category: GoldenEagle.Navisworks
# Isolate Your Clashed Element By Select View And Excel.
# "Make Sure Your Excel Export with Item ID Only"
# packages: archi-lab.net 2020.23.12

FilePath = Input(FilePath: string)
sheetName = Input(sheetName: string = "Sheet1")
importFromExcel = Custom[ImportFromExcel](filePath=FilePath, sheetName=sheetName)  # Data Import from excel without any null or empty data.
# note: Package Name - Golden Eagle
# Author - Prem Talreja
# Contact - goldeneagle.bim@gmail.com
# Node Name - Clash Isolate In View By Navisworks Report
code_block = CodeBlock(t2=importFromExcel)
# ---------- code_block.designscript (5 lines) ----------
t1 = DSCore.List.Transpose(t2);
bool1 = DSCore.Object.IsNull(t1);
t3 = DSCore.List.FilterByBoolMask(t1, bool1);
t4 = Dictionary.ValueAtKey(t3, "in");
t5 = Dictionary.ValueAtKey(t3, "out");
# ----------------------------------------
string_from_object = FromObject(obj=code_block.t5)
code_block_2 = CodeBlock(t1=string_from_object)
# ---------- code_block_2.designscript (6 lines) ----------
str1 = String.Remove(t1, 0, 12);
t2 = Select.ByElementId(str1);
bool1 = DSCore.Object.IsNull(t2);
t3 = DSCore.List.FilterByBoolMask(t2, bool1);
t4 = Dictionary.ValueAtKey(t3, "in");
t5 = Dictionary.ValueAtKey(t3, "out");
# ----------------------------------------
View = Input(View: var[]..[])
isolate_in_view = Custom[Isolate in View](element=code_block_2.t5, view=View)  # package archi-lab.net; This node will take input of elements and a view to isolate selected elements in a view.
element = Output(isolate_in_view)  # "_element"
