# Dynamo custom node PipeSlopeSchedule.dyf (Dynamo 2.3.0.5885)
# category: GoldenEagle.Schedule
# Before this run "PipeSlopeValuetoCommentParameter"
# Find this node in Parameter Category in Golden Eagle.

categories = Categories("OST_PipeCurves")
ScheduleName = Input(ScheduleName: var[]..[])
schedule_type = ScheduleTypes("RegularSchedule")
code_block = CodeBlock(t1=categories, t2=ScheduleName, t3=schedule_type)
# ---------- code_block.designscript (2 lines) ----------
scheduleview1 = ScheduleView.CreateSchedule(t1, t2, t3);
schedulablefield1 = ScheduleView.SchedulableFields(scheduleview1);
# ----------------------------------------
string_from_object = FromObject(obj=code_block.schedulablefield1)
string_from_object_2 = FromObject(obj=code_block.schedulablefield1)
string_from_object_3 = FromObject(obj=code_block.schedulablefield1)
# note: Package Name - Golden Eagle
# Author - Prem Talreja
# Contact - goldeneagle.bim@gmail.com
# Node Name - Pipe Slope Schedule
code_block_2 = CodeBlock(t4=string_from_object, schedulablefield1=code_block.schedulablefield1, t8=string_from_object_2, t12=string_from_object_3, scheduleview1=code_block.scheduleview1)
# ---------- code_block_2.designscript (20 lines) ----------
bool1 = String.Contains(t4, "Family and Type", false);
t5 = DSCore.List.FilterByBoolMask(schedulablefield1, bool1);
t6 = Dictionary.ValueAtKey(t5, "in");
t7 = Dictionary.ValueAtKey(t5, "out");
list = t6;
t2 = Get.ValueAtIndex(list, 0);
bool2 = String.Contains(t8, "System Type", false);
t9 = DSCore.List.FilterByBoolMask(schedulablefield1, bool2);
t10 = Dictionary.ValueAtKey(t9, "in");
t11 = Dictionary.ValueAtKey(t9, "out");
list1 = t10;
t1 = Get.ValueAtIndex(list1, 0);
bool3 = String.Contains(t12, "Comments", false);
t13 = DSCore.List.FilterByBoolMask(schedulablefield1, bool3);
t14 = Dictionary.ValueAtKey(t13, "in");
t15 = Dictionary.ValueAtKey(t13, "out");
list2 = t14;
t3 = Get.ValueAtIndex(list2, 0);
t16 = DSCore.List.Join([t2, t1, t3]);
scheduleview2 = ScheduleView.AddFields(scheduleview1, t16);
# ----------------------------------------
scheduleView = Output(code_block_2.scheduleview2)
