# Dynamo custom node PipeSlopeValuetoCommentParameter.dyf (Dynamo 2.3.0.5885)
# category: GoldenEagle.Parameter
# Set All your slope values to comments parameter
# packages: SaveandDetached 0.0.1

categories = Categories("OST_PipeCurves")
all_elements_of_category = ElementsOfCategory(Category=categories)
code_block = CodeBlock { str1 = "Slope"; str2 = "Comments"; }
# note: Package Name - Golden Eagle
# Author - Prem Talreja
# Contact - goldeneagle.bim@gmail.com
# Node Name - Pipe Slope Parameter to Comment Parameter
getandSetParameterValueByName = Custom[GetandSetParameterValueByName](Elements=all_elements_of_category, GetparameterName=code_block.str1, SetparameterName=code_block.str2)  # package SaveandDetached; Get Parameter Value From Element and Set it on other Parameter.
Element = Output(getandSetParameterValueByName)
