# Dynamo custom node PipefromPointcloudBySelectPoints.dyf (Dynamo 2.3.0.5885)
# category: GoldenEagle.SCANToBIM
# Script based on sastrugi packages and dynamo forum
# packages: MEPover 2019.12.1, ghfjehueiv 1.1.1

code_block = CodeBlock { 10000; }
SelectPoints = Input(SelectPoints: bool = true)
pointcloud_select_points_in_view = Custom[❄_Pointcloud Select Points in View](PointSampleSize=code_block, Refresh=SelectPoints)  # package ghfjehueiv; (Sastrugi_Pointcloud_Geometry) This node allows users to select a specific number of Pointcloud Points by creating a selection region in the Active View.
byBestFitThroughPoints = Line.ByBestFitThroughPoints(bestFitPoints=pointcloud_select_points_in_view.Points)
code_block_2 = CodeBlock { [0.3,0.4,0.5,0.6,0.7]; }
planeAtParameter = Curve.PlaneAtParameter(curve=byBestFitThroughPoints, param=code_block_2)
distanceTo = Geometry.DistanceTo(geometry=planeAtParameter, other=pointcloud_select_points_in_view.Points, lacing=CrossProduct)
sortIndexByValue = List.SortIndexByValue(list=distanceTo)
code_block_3 = CodeBlock { 20; }
takeItems = List.TakeItems(list=sortIndexByValue@L2, amount=code_block_3)
getItemAtIndex = List.GetItemAtIndex(list=pointcloud_select_points_in_view.Points, index=takeItems)
byBestFitThroughPoints_2 = Circle.ByBestFitThroughPoints(points=getItemAtIndex)
centerPoint = Circle.CenterPoint(circle=byBestFitThroughPoints_2)
byBestFitThroughPoints_3 = Line.ByBestFitThroughPoints(bestFitPoints=centerPoint)
element_types = ElementTypes("PipeType")
all_elements_of_type = ElementsOfType(element_type=element_types)
code_block_4 = CodeBlock(pipe=all_elements_of_type) { pipe[0]; }
element_types_2 = ElementTypes("PipingSystemType")
all_elements_of_type_2 = ElementsOfType(element_type=element_types_2)
code_block_5 = CodeBlock(e=all_elements_of_type_2) { e.Name; }
code_block_6 = CodeBlock(input=code_block_5) { requiredtype = IndexOf(input,"Vent"); }
getItemAtIndex_2 = List.GetItemAtIndex(list=all_elements_of_type_2, index=code_block_6)
SelectLevel = Input(SelectLevel: var[]..[])
radius = Circle.Radius(circle=byBestFitThroughPoints_2)
average = Math.Average(numbers=radius)
code_block_7 = CodeBlock(dist=average) { dist*2; }
# note: Package Name - Golden Eagle
# Author - Prem Talreja
# Contact - goldeneagle.bim@gmail.com
# Node Name - Pipe By Pointcloud
# [Script by Sastrugi based on dynamo forum]
byLines = Custom[Pipe.ByLines](Lines=byBestFitThroughPoints_3, PipeType=code_block_4, SystemType=getItemAtIndex_2, level=SelectLevel, Diameter=code_block_7)  # package MEPover; Creates a pipe by Line, PipeType, SystemType, Level and Diameter
Pipes = Output(byLines)
