# Dynamo custom node PointCloudOnOff.dyf (Dynamo 2.3.0.5885)
# category: GoldenEagle.SCANToBIM
# PointCloud file on/off by click, You can make revit button by this

categories = Categories("OST_PointClouds")
OnOff = Input(OnOff: bool = false)
# note: Package Name - Golden Eagle
# Author - Prem Talreja
# Contact - goldeneagle.bim@gmail.com
# Node Name - PointCloud On/Off
code_block = CodeBlock(t1=categories, t2=OnOff)
# ---------- code_block.designscript (4 lines) ----------
document1 = Document.Current;
view1 = Document.ActiveView(document1);
overridegraphicsettings1 = OverrideGraphicSettings.ByProperties(null, null, null, null, null, null, null, null, -1, -1, -1, "Undefined", false);
view2 = Elements.View.SetCategoryOverrides(view1<1L>, t1<1L>, overridegraphicsettings1<1L>, t2<1L>);
# ----------------------------------------
view = Output(code_block.view2)
