# Dynamo custom node RoundDuctfromPointcloudBySelectPoint.dyf (Dynamo 2.3.0.5885)
# category: GoldenEagle.SCANToBIM
# Create Round Duct By Selecting point from scan file, based on sastrugi package
# packages: MEPover 2019.12.1, Rhythm 2020.2.13, ghfjehueiv 1.1.1

element_types = ElementTypes("DuctType")
all_elements_of_type = ElementsOfType(element_type=element_types)
name = Element.Name(element=all_elements_of_type)
string_from_object = FromObject(obj=name)
code_block = CodeBlock { "Taps / Short Radius"; }
contains = String.Contains(str=string_from_object, searchFor=code_block)
filterByBoolMask = List.FilterByBoolMask(list=all_elements_of_type, mask=contains)
code_block_2 = CodeBlock(duct=filterByBoolMask.in) { duct[0]; }
all_elements_of_model_category = ModelCategoriesCollect("Ducts")
code_block_3 = CodeBlock { 10000; }
SelectPoints = Input(SelectPoints: bool = true)
pointcloud_select_points_in_view = Custom[❄_Pointcloud Select Points in View](PointSampleSize=code_block_3, Refresh=SelectPoints)  # package ghfjehueiv; (Sastrugi_Pointcloud_Geometry) This node allows users to select a specific number of Pointcloud Points by creating a selection region in the Active View.
byBestFitThroughPoints = Line.ByBestFitThroughPoints(bestFitPoints=pointcloud_select_points_in_view.Points)
code_block_4 = CodeBlock { [0.3,0.4,0.5,0.6,0.7]; }
planeAtParameter = Curve.PlaneAtParameter(curve=byBestFitThroughPoints, param=code_block_4)
distanceTo = Geometry.DistanceTo(geometry=planeAtParameter, other=pointcloud_select_points_in_view.Points, lacing=CrossProduct)
sortIndexByValue = List.SortIndexByValue(list=distanceTo)
code_block_5 = CodeBlock { 20; }
takeItems = List.TakeItems(list=sortIndexByValue@L2, amount=code_block_5)
getItemAtIndex = List.GetItemAtIndex(list=pointcloud_select_points_in_view.Points, index=takeItems)
byBestFitThroughPoints_2 = Circle.ByBestFitThroughPoints(points=getItemAtIndex)
centerPoint = Circle.CenterPoint(circle=byBestFitThroughPoints_2)
byBestFitThroughPoints_3 = Line.ByBestFitThroughPoints(bestFitPoints=centerPoint)
element_types_2 = ElementTypes("MEPSystemType")
all_elements_of_type_2 = ElementsOfType(element_type=element_types_2)
code_block_6 = CodeBlock(e=all_elements_of_type_2) { e.Name; }
code_block_7 = CodeBlock(input=code_block_6) { requiredtype = IndexOf(input,"Supply Air"); }
getItemAtIndex_2 = List.GetItemAtIndex(list=all_elements_of_type_2, index=code_block_7)
SelectLevel = Input(SelectLevel: var[]..[])
radius = Circle.Radius(circle=byBestFitThroughPoints_2)
average = Math.Average(numbers=radius)
code_block_8 = CodeBlock(dist=average) { dist*2; }
# note: Package Name - Golden Eagle
# Author - Prem Talreja
# Contact - goldeneagle.bim@gmail.com
# Node Name - Pipe By Pointcloud
# [Script by Sastrugi based on dynamo forum>Updated by Prem Talreja}
byLines = Custom[DuctRound.ByLines](Lines=byBestFitThroughPoints_3, DuctType=filterByBoolMask.in, MechanicalSystemType=getItemAtIndex_2, level=SelectLevel, Diameter=code_block_8, lacing=CrossProduct)  # package MEPover; Create round Ducts by Lines, DuctType, SystemType, Level and Diameter
Round_Ducts = Output(byLines)
