# Dynamo custom node SerialNumberByName.dyf (Dynamo 2.3.0.5885)
# category: GoldenEagle.Parameter
# Set Serial Number to elements parameters

Elements = Input(Elements: var[]..[])
# note: Package Name - Golden Eagle
# Author - Prem Talreja
# Contact - goldeneagle.bim@gmail.com
# Node Name - Serial Number By Name
ParameterName = Input(ParameterName: string)
code_block = CodeBlock { 1..9999; }
string_from_object = FromObject(obj=code_block)
code_block_2 = CodeBlock(t4=Elements, t5=ParameterName, t6=string_from_object)
# ---------- code_block_2.designscript (5 lines) ----------
t1 = t4;
t2 = t5;
t3 = t6;
element1 = Elements.Element.SetParameterByName(t1, t2, t3);
str2 = String.PadLeft(t6, 3, "0");
# ----------------------------------------
Element = Output(code_block_2.element1)
