# Dynamo custom node SetTypeParameterValueByName.dyf (Dynamo 2.3.0.5885)
# category: GoldenEagle.Parameter
# Fill value on type parameter by selecting elements

Element = Input(Element: var[]..[])
ParameterName = Input(ParameterName: string)
Value = Input(Value: string)
# note: Package Name - Golden Eagle
# Author - Prem Talreja
# Contact - goldeneagle.bim@gmail.com
# Node Name - Set Type Parameter Value By Name
code_block = CodeBlock(t1=Element, t2=ParameterName, t3=Value) { element1 = Elements.Element.ElementType(t1); element2 = Elements.Element.SetParameterByName(element1, t2, t3); }
Element_2 = Output(code_block.element2)  # "Element"
