# Dynamo custom node ViewDuplicateMultipleTimes.dyf (Dynamo 2.3.0.5885)
# category: GoldenEagle.Views
# Duplicate View for "N" numbers times.
# packages: archi-lab.net 2020.23.12

Views = Input(Views: var[]..[])
NumberofViewstoDuplicate = Input(NumberofViewstoDuplicate: var[]..[])
duplicate_options = DuplicateOptionsUi("WithDetailing")
# note: Package Name - Golden Eagle
# Author - Prem Talreja
# Contact - goldeneagle.bim@gmail.com
# Node Name - View Duplicate Multiple Times
code_block = CodeBlock(t2=Views, t6=NumberofViewstoDuplicate, t10=duplicate_options)
# ---------- code_block.designscript (8 lines) ----------
t1 = [t2];
t3 = DSCore.List.Flatten(t1, -1);
t4 = Elements.Element.GetParameterValueByName(t3, "View Name");
t5 = (1..t6..1);
t7 = DSCore.List.Flatten(t5, -1);
t8 = " copy " + t7;
t9 = t4<1> + t8<2>;
view1 = archilab.Views.Duplicate(t3, t9, t10);
# ----------------------------------------
views = Output(code_block.view1)
