# Dynamo custom node ViewNameEdit.dyf (Dynamo 2.3.0.5885)
# category: GoldenEagle.Views
# ViewName value find/replace

Views = Input(Views: var[]..[])
code_block = CodeBlock(t2=Views) { t1 = [t2]; t3 = DSCore.List.Flatten(t1, -1); t4 = Elements.Element.GetParameterValueByName(t3, "View Name"); }
string_from_object = FromObject(obj=code_block.t4)
FindValue = Input(FindValue: string)
ReplaceValue = Input(ReplaceValue: string)
# note: Package Name - Golden Eagle
# Author - Prem Talreja
# Contact - goldeneagle.bim@gmail.com
# Node Name - View Name Edit
code_block_2 = CodeBlock(t1=string_from_object, t2=FindValue, t3=ReplaceValue, t4=code_block.t1) { str1 = String.Replace(t1, t2, t3); element1 = Elements.Element.SetParameterByName(t4, str1, str1); }
Element = Output(code_block_2.element1)
